# Grasshopper definition 200310_DotNET_GoogleAPIs_Sheet_MWT_00.gh (Grasshopper 1.0.7)

# ---- group: Get Curve Points
crv = Curve(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)
crv_2 = Curve(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)
crv_3 = Curve(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)
divide = DivideCurve(Curve=crv, Count=Slider(35, range=0..100), Kinks=False)  # -> Points, Tangents, Parameters
pdecon = Deconstruct(Point=divide.Points)  # -> XComponent, YComponent, ZComponent
entwine = Entwine(Branch00=pdecon.XComponent, Branch01=pdecon.YComponent, Branch02=pdecon.ZComponent, FlattenInputs=True)

# ---- group: Sheets IDs
# Demo 1: Writing/Reading the Coordinates of Curve to a Sheet
panel = Panel("1qHgTZY3hnVN_ilBD5TCZhVC3lKL81vYQPvgEeSoDEPw")

# ---- group: Sheet and Range to Read
panel_2 = Panel("Foo!A3:C8")

# ---- group: Sheet and Cell to Insert Data to
panel_3 = Panel("Foo!A3")

# ---- group: Authorise Google Sheets Client
gsa = PythonScript()  # -> Credential, LocalUser
# ---------- gsa: Python ----------
"""
Ported to IronPython by Anders Holden Deleuran from this C# tutorial:
https://developers.google.com/sheets/api/quickstart/dotnet
"""

import os
import clr
import System

# Define paths
credentialsPath = r"C:\GoogleSheets"
dependenciesPath = r"C:\GoogleSheets\Dependencies"
authDllPath = os.path.join(dependenciesPath,"Google.Apis.Auth.dll")

# Add references and import namespaces
clr.AddReferenceToFileAndPath(authDllPath)
import Google.Apis.Auth.OAuth2 as gOauth2
import Google.Apis.Sheets.v4 as gSheets
import Google.Apis.Util.Store as gUtilStore

def authoriseSheetsClient(clientPath,clientSecretFile,localUserName):
    
    # Define client scope (ie. read only, Sheets or Drive etc.) and path
    scopes = System.Array[str]([gSheets.SheetsService.Scope.Spreadsheets])
    clientSecretPath = System.IO.Path.Combine(clientPath,clientSecretFile)
    
    # Authorise and save client credential token to clientPath
    with System.IO.FileStream(clientSecretPath, System.IO.FileMode.Open,
    System.IO.FileAccess.Read) as stream:
        credential = gOauth2.GoogleWebAuthorizationBroker.AuthorizeAsync(
        gOauth2.GoogleClientSecrets.Load(stream).Secrets,
        scopes,
        localUserName,
        System.Threading.CancellationToken.None,
        gUtilStore.FileDataStore(clientPath,True)).Result
        
    return credential

# Authorise
localUserName = System.Environment.UserName
credential = authoriseSheetsClient(credentialsPath,"client_secret.json",localUserName)

# Output to GH
if credential:
    Credential = credential
    LocalUser = credential.UserId
# ---------- end gsa ----------

# ---- group: Write to Google Sheet
spreadsheetid = Text(panel)
credential = Data(gsa.Credential)
sheetcell = Text(panel_3)
data = Data(entwine)
gsw = PythonScript(Credential=credential, SpreadsheetID=spreadsheetid, SheetCell=sheetcell, Data=data)  # -> Report; inputs Data: tree
# ---------- gsw: Python ----------
"""
Write to a Google Sheet.
    Inputs:
        Credential: {item,Google.Apis.Auth.OAuth2.UserCredential}
        SpreadsheetID: e.g. "1qHgTZY3hnVN_ilBD5TCZhVC3lKL81vYQPvgEeSoDEPw" {item,string}
        SheetCell: e.g. "Foo!A3" {item,string}
        Data: {tree,system.object}
    Outputs:
        Report: 
    Remarks:
        Author: Anders Holden Deleuran
        Rhino: 6.24.20055.18581
        Version: 200310
"""

import sys
import clr
import System

# Define paths
dependenciesPath = r"C:\GoogleSheets\Dependencies"

# Add Google dependencies folder to path
if dependenciesPath not in sys.path:
    sys.path.append(dependenciesPath)

# Reference and import Google assemblies/namespaces
clr.AddReferenceToFile("Google.Apis.Sheets.V4")
import Google.Apis.Sheets.v4 as gSheets
clr.AddReferenceToFile("Google.Apis.dll")
import Google.Apis.Services as gServices

def makeSheetsService(credential):
    
    """ Initialise a Google sheets service using a credential token """
    
    initializer = gServices.BaseClientService.Initializer()
    initializer.HttpClientInitializer = credential
    service = gSheets.SheetsService(initializer)
    
    return service

def makeReport(response):
    
    """ Get and output a response report as a string """
    
    r = ""
    r += "Range: " + str(response.UpdatedRange) + "\n"
    r += "Cells: " + str(response.UpdatedCells) + "\n"
    r += "Columns: " + str(response.UpdatedColumns) + "\n"
    r += "Rows: " + str(response.UpdatedRows) + "\n"
    
    return r

# Check input params
if Credential and SpreadsheetID and SheetCell and Data:
    
    service = makeSheetsService(Credential)
    
    # Unpack DataTree and convert it to ValueRange
    dataList = [list(b) for b in Data.Branches]
    valueRange = gSheets.Data.ValueRange()
    valueRange.MajorDimension = "columns"
    valueRange.Values = dataList
    
    # Define the update call and execute it
    update = service.Spreadsheets.Values.Update(valueRange, SpreadsheetID, SheetCell)
    update.ValueInputOption = gSheets.SpreadsheetsResource.ValuesResource.UpdateRequest.ValueInputOptionEnum.RAW
    response = update.Execute()
    
    # Make and output report
    Report = makeReport(response)
else:
    Report = []
# ---------- end gsw ----------

# ---- group: Read Google Sheet
spreadsheetid_2 = Text(panel)
sheetrange = Text(panel_2)
credential_2 = Data(gsa.Credential)
gsr = PythonScript(Credential=credential_2, SpreadsheetID=spreadsheetid_2, SheetRange=sheetrange)  # -> Data
# ---------- gsr: Python ----------
"""
Read a Google Sheet.
    Inputs:
        Credential: {item,Google.Apis.Auth.OAuth2.UserCredential}
        SpreadsheetID: e.g. "1qHgTZY3hnVN_ilBD5TCZhVC3lKL81vYQPvgEeSoDEPw" {item,string}
        SheetRange: e.g. "Foo!A3:C8" {item,string}
    Outputs:
        Data: Read data {tree,system.object}
    Remarks:
        Author: Anders Holden Deleuran
        Rhino: 6.24.20055.18581
        Version: 200310
"""

import sys
import clr
import System
import Grasshopper as gh

# Define paths
dependenciesPath = r"C:\GoogleSheets\Dependencies"

# Add Google dependencies folder to path
if dependenciesPath not in sys.path:
    sys.path.append(dependenciesPath)

# Reference and import Google assemblies/namespaces
clr.AddReferenceToFile("Google.Apis.Sheets.V4")
import Google.Apis.Sheets.v4 as gSheets
clr.AddReferenceToFile("Google.Apis.dll")
import Google.Apis.Services as gServices

def listToTree(nestedList):
    
    """ Convert a nested python iterable to a datatree """
    
    dt = gh.DataTree[object]()
    for i,l in enumerate(nestedList):
        dt.AddRange(l,gh.Kernel.Data.GH_Path(i))
        
    return dt

def makeSheetsService(credential):
    
    """ Initialise a Google sheets service using a credential token """
    
    initializer = gServices.BaseClientService.Initializer()
    initializer.HttpClientInitializer = credential
    service = gSheets.SheetsService(initializer)
    
    return service

if Credential and SpreadsheetID and SheetRange:
    
    # Make service and get the sheet data
    service = makeSheetsService(Credential)
    request = service.Spreadsheets.Values.Get(SpreadsheetID,SheetRange)
    response = request.Execute()
    
    # Extract values
    values = response.Values
    #print values
    if values:
        Data = listToTree(values)
    
else:
    Data = []
# ---------- end gsr ----------

# ----
panel_4 = Panel(gsr)
panel_5 = Panel(gsw)
